# Dynamo graph 03_Sorting_with_colors_red_solved.dyn (Dynamo 2.0.2.6826)

integer_slider = IntegerSlider(50, range=0..200 step 1)
randomList = Math.RandomList(amount=integer_slider)
randomList_2 = Math.RandomList(amount=integer_slider)
byCoordinates = Point.ByCoordinates(x=randomList, y=randomList_2)
origin = Point.Origin()
python_script = Python(IN[0]=byCoordinates, IN[1]=origin)
# ---------- python_script.python (40 lines) ----------
import clr
clr.AddReference("ProtoGeometry")
from Autodesk.DesignScript.Geometry import Vector
from Autodesk.DesignScript.Geometry import Sphere

clr.AddReference("GeometryColor")
from Modifiers import GeometryColor

clr.AddReference("DSCoreNodes")
from DSCore import *

import sys
sys.path.append(r'C:\Program Files(x86)\IronPython 2.7\Lib')
sys.path.append(r'C:\Python27\Lib')
import math
import colorsys

random_points = IN[0]
origin = IN[1]

distance_and_points = []
for point in random_points:
	vector = Vector.ByTwoPoints(origin, point)
	distance = vector.Length
	group = [distance, point]
	distance_and_points.append(group)
	
sorted_points = sorted(distance_and_points)

maxdistance = math.sqrt(2)
geomWithColors = []
for pair in sorted_points:
	sphere = Sphere.ByCenterPointRadius(pair[1], 0.05)
	normalized = pair[0] / maxdistance
	pyColor = colorsys.hls_to_rgb(1.0, normalized, 1.0)
	c = Color.ByARGB(255, pyColor[0] * 255, pyColor[1] * 255, pyColor[2] * 255)
	geomWithColor = GeometryColor.ByGeometryColor(sphere, c)
	geomWithColors.append(geomWithColor)

OUT = sorted_points, geomWithColors, pyColor
# ----------------------------------------
watch = Watch(python_script)
