# Dynamo graph 04_Terrasse.dyn (Dynamo 1.3.3.4111)

# group: Velge linjer
categories = Categories("Lines")
all_elements_of_category = ElementsOfCategory(categories)
curves = Element.Curves(all_elements_of_category)
select_model_element = DSModelElementSelection()  # 1 picked in the model
curves_2 = Element.Curves(select_model_element)
select_model_element_2 = DSModelElementSelection()  # 1 picked in the model
curves_3 = Element.Curves(select_model_element_2)

startPoint = Curve.StartPoint(curves)
code_block = CodeBlock { 0; }
getItemAtIndex = List.GetItemAtIndex(list=startPoint, index=code_block, lacing=Longest)
byPoints = Polygon.ByPoints(getItemAtIndex)
byPatch = Surface.ByPatch(byPoints)

# group: Input
plankebredde = DoubleSlider(128, range=8..200 step 1)
avstand_mellom = DoubleSlider(8, range=0..20 step 1)
tykkelse_på_plank = DoubleSlider(26, range=10..50 step 1)

add = plankebredde + avstand_mellom

# group: Masterlinje for terrassens utstrekning
startPoint_2 = Curve.StartPoint(curves_2)
pointsAtSegmentLengthFromPoint = Curve.PointsAtSegmentLengthFromPoint(curves_2, startPoint_2, add)

# group: Linje for plankenes lengderetning
startPoint_3 = Curve.StartPoint(curves_3)
endPoint = Curve.EndPoint(curves_3)
byTwoPoints = Vector.ByTwoPoints(start=startPoint_3, end=endPoint)

# group: Beregning av linjer for uttegning av plank
boundingBox = Geometry.BoundingBox(byPatch)
maxPoint = BoundingBox.MaxPoint(boundingBox)
minPoint = BoundingBox.MinPoint(boundingBox)
code_block_2 = CodeBlock(pt2=maxPoint, pt1=minPoint, pt=pointsAtSegmentLengthFromPoint, direction=byTwoPoints)
# ---------- code_block_2.designscript (6 lines) ----------
dx = pt2.X - pt1.X;
dy = pt2.Y - pt1.Y;
distance = Math.Sqrt(Math.Pow(dx, 2) + Math.Pow(dy, 2));
otherPt = Point.ByCoordinates(pt.X, pt.Y, pt.Z);
vecs= Point.Translate(otherPt, direction, distance);
lines = Line.ByStartPointEndPoint(pt, vecs);
# ----------------------------------------
flatten = Flatten(code_block_2.lines)
flatten_2 = Flatten(curves)
python_script = Python(IN[0]=flatten, IN[1]=flatten_2)
# ---------- python_script.python (82 lines) ----------
import clr
clr.AddReference('ProtoGeometry')
clr.AddReference('DSCoreNodes') 
import DSCore
from DSCore import *
from Autodesk.DesignScript.Geometry import *

#custom debug code
import sys
sys.path.append(r'C:\Program Files (x86)\IronPython 2.7\Lib')
import time
import math
from StringIO import StringIO


#The inputs to this node will be stored as a list in the IN variables.
dataEnteringNode = IN
OUT = []

output = StringIO()
sys.stdout = output
t1 = time.time()
print('Starting Test')
print('=============')

def line_intersects(p1sp,p1ep,p2sp,p2ep):
	xdiff = (p1sp.X - p1ep.X, p2sp.X - p2ep.X)
	ydiff = (p1sp.Y - p1ep.Y, p2sp.Y - p2ep.Y)
	
	def determinant(a1,a2,b1,b2):
		return a1 * b2 - a2 * b1
	
	div = determinant(xdiff[0],xdiff[1],ydiff[0],ydiff[1])
	if div > 0.0001:
		d = (determinant(p1sp.X,p1sp.Y,p1ep.X,p1ep.Y), determinant(p2sp.X,p2sp.Y,p2ep.X,p2ep.Y))
		x = determinant(d[0],d[1], xdiff[0],xdiff[1]) / div
		y = determinant(d[0],d[1], ydiff[0],ydiff[1]) / div
		if x > p1sp.X and x < p1ep.X and y > p2sp.Y and y < p2ep.Y:
			return Point.ByCoordinates(x,y)

def distance(pt1, pt2):
	dx = pt2.X - pt1.X
	dy = pt2.Y - pt1.Y
	dist = math.sqrt(dx**2 + dy**2)
	return dist

starts = []
ends = []

for l1 in IN[0]:
	if(l1.StartPoint.X > l1.EndPoint):
		p1sp = l1.EndPoint
		p1ep = l1.StartPoint
	else:
		p1sp = l1.StartPoint
		p1ep = l1.EndPoint
	data = []
	for l2 in IN[1]:
		if l1 <> l2:
			if(l2.StartPoint.X < l2.EndPoint):
				p2sp = l2.EndPoint
				p2ep = l2.StartPoint
			else:
				p2sp = l2.StartPoint
				p2ep = l2.EndPoint
			if  p1sp.X < p2sp.X and p1ep.X > p2ep.X  or p1sp.Y > p2sp.Y and p1ep.Y < p2ep.Y:
				intersection = line_intersects(p1sp,p1ep,p2sp,p2ep)
				print(intersection)
				if not (intersection is None):
					dist = distance(intersection, p1ep)
					print(dist)
					if(dist > 0.0001):
						starts.append(intersection)
						ends.append(p1ep)

OUT.append(starts);
OUT.append(ends);
		
duration = time.time() - t1
print('Finished in {} seconds'.format(duration))

#OUT = output.getvalue()
# ----------------------------------------

dekoding = Watch(python_script)

# group: Lage linjer og vektorer for plank
code_block_3 = CodeBlock { 0; 1; }
getItemAtIndex_2 = List.GetItemAtIndex(list=python_script, index=code_block_3.out0)
getItemAtIndex_3 = List.GetItemAtIndex(list=python_script, index=code_block_3.out1)
byTwoPoints_2 = Vector.ByTwoPoints(start=getItemAtIndex_2, end=getItemAtIndex_3)
byStartPointEndPoint = Line.ByStartPointEndPoint(startPoint=getItemAtIndex_2, endPoint=getItemAtIndex_3)

# group: Beregne nødvendig antall meter plank
length = Vector.Length(byTwoPoints_2)
sum = Math.Sum(length)
code_block_4 = CodeBlock(x=sum) { Math.Ceiling(x/1000.0); }
antall_meter_plank = Watch(code_block_4)

# group: Masterlinje som inversvektor
firstItem = List.FirstItem(curves_2)
endPoint_2 = Curve.EndPoint(firstItem)
startPoint_4 = Curve.StartPoint(firstItem)
byTwoPoints_3 = Vector.ByTwoPoints(start=endPoint_2, end=startPoint_4)

# group: Tegne ut geometri som DirectShape
byStartPointDirectionLength = Line.ByStartPointDirectionLength(startPoint=pointsAtSegmentLengthFromPoint, direction=byTwoPoints_3, length=plankebredde)
flatten_3 = Flatten(byStartPointDirectionLength)
bySweep = Surface.BySweep(flatten_3, byStartPointEndPoint)
thicken = Surface.Thicken(surface=bySweep, thickness=tykkelse_på_plank)
categories_2 = Categories("Floors")
code_block_5 = CodeBlock { Material.ByName("Pine"); }
code_block_6 = CodeBlock { "Terrasse"; }
byGeometry = DirectShape.ByGeometry(geometry=thicken, category=categories_2, material=code_block_5, name=code_block_6)  # frozen

# group: Sette ut parametriske families
family_types = FamilyTypes("Planke:Planke")
code_block_7 = CodeBlock(vector=byTwoPoints_3, plankwidth=plankebredde, spacing=avstand_mellom, geom=getItemAtIndex_3)
# ---------- code_block_7.designscript (3 lines) ----------
vecNormal = Vector.Normalized(vector);
distance = plankwidth/2 + spacing;
Point.Translate(geom<1>, vecNormal, distance);
# ----------------------------------------
byPoint = FamilyInstance.ByPoint(familyType=family_types, point=code_block_7.out2)
YAxis = Vector.YAxis()
ZAxis = Vector.ZAxis()
angleAboutAxis = Vector.AngleAboutAxis(byTwoPoints_2, YAxis, ZAxis)
code_block_8 = CodeBlock(offset=angleAboutAxis) { rot = offset + 180; }
setRotation = FamilyInstance.SetRotation(familyInstance=byPoint, degree=code_block_8)
code_block_9 = CodeBlock(elem=setRotation, lengths=length, widths=plankebredde, heights=tykkelse_på_plank)
# ---------- code_block_9.designscript (9 lines) ----------
length = "Lengde";
width = "Bredde";
height = "Tykkelse";
lenParam = Parameter.ParameterByName(elem, length);
Parameter.SetValue(lenParam, lengths);
wParam = Parameter.ParameterByName(elem, width);
wParam.SetValue(widths);
hParam = Parameter.ParameterByName(elem, height);
hParam.SetValue(heights);
# ----------------------------------------
categories_3 = Categories("VolumeOfInterest")
all_elements_of_category_2 = ElementsOfCategory(categories_3)
code_block_10 = CodeBlock(list=all_elements_of_category_2) { list[0]; }
watch = Watch(angleAboutAxis)
watch_2 = Watch(code_block_7.out2)
