# Dynamo graph 01_Sorting.dyn (Dynamo 2.0.2.6826)

integer_slider = IntegerSlider(106, range=0..200 step 1)
randomList = Math.RandomList(amount=integer_slider)
randomList_2 = Math.RandomList(amount=integer_slider)
byCoordinates = Point.ByCoordinates(x=randomList, y=randomList_2)
origin = Point.Origin()
python_script = Python(IN[0]=byCoordinates, IN[1]=origin)
# ---------- python_script.python (19 lines) ----------
import clr
clr.AddReference("ProtoGeometry")
from Autodesk.DesignScript.Geometry import Vector

random_points = IN[0]
origin = IN[1]

distance_and_points = []
points = []
for point in random_points:
	vector = Vector.ByTwoPoints(origin, point)
	distance = vector.Length
	group = [distance, point]
	distance_and_points.append(group)
	
sorted_points = sorted(distance_and_points)

# This is what goes to the output
OUT = sorted_points
# ----------------------------------------
watch = Watch(python_script)
