# Dynamo graph 02_Using_modules.dyn "02_Sorting_with_module" (Dynamo 2.0.2.6826)

python_script = Python()
# ---------- python_script.python (12 lines) ----------
# This is the magic that allows you to import most regular CPython libraries
import sys
sys.path.append(r'C:\Program Files(x86)\IronPython 2.7\Lib')

# Im not sure this is needed, i suddenly did need it for reasons unknown
sys.path.append(r'C:\Python27\Lib') 

# Now we can import the os module
import os

# This is what goes to the output
OUT = os.listdir(r'C:\Program Files')
# ----------------------------------------
watch = Watch(python_script)
